# Grasshopper definition PrintTheseCurves_01.gh (Grasshopper 1.0.7)

target_path = Panel("/Users/robin/Projects/BURG/BigPrinter /PrintAlgorithms/algorithmic_vasemode/Testfiles")
save_file = Button()
filename_extension = Panel("Multiprint_38")

referencedcurves_crv = Curve([<curve referenced from the Rhino model> x2])
curve_overlap = Slider(20.322, range=0.01..55)
wait_for_temperature = BooleanToggle(True)
home_y = BooleanToggle(False)
home_x = BooleanToggle(False)
home_z = BooleanToggle(True)
extrusion_multiplication_factor = Panel("0.51")
first_layer_height = Slider(5, range=-20.001..20)
segment_length = Slider(1.51, range=0.8..300)
extrusion = BooleanToggle(True)
feedrate = Panel("550")
temperature = Panel("260")
curves = Curve(reparameterize(referencedcurves_crv))
file_path = FilePath("/Users/Robin/Google Drive/HF_Printing2021/Alena_Verbinder/Gcodes/")

# ---- group: Homing Options
merge = Merge(Data1=home_x, Data2=home_y, Data3=home_z)
panel = Panel("""X
Y
Z""")
cull_pattern = CullPattern(List=panel, CullPattern=merge)
merge_2 = Merge(Data1="G28", Data2=cull_pattern)
space = Panel(" ")
text_join = TextJoin(Text=merge_2, Join=space)

# ----
get_time_py = GhPythonScript(get_time=save_file)  # -> out, time_string; inputs get_time: Boolean
# ---------- get_time_py: Python ----------
"""Provides a scripting component.
    Inputs:
       
    Output:
        a: The a output variable"""

__author__ = "robin"

import rhinoscriptsyntax as rs
from datetime import datetime 

def give_time(): 
    time = datetime.now()
    time_string = time.strftime("%Y%m%d-%H%M")
    return time_string
    
if get_time: 
    time_string = give_time()
# ---------- end get_time_py ----------
file_extension = Panel(".gcode")
file_path_2 = FilePath(file_path)
sub_curve = SubCurve(BaseCurve=curves, Domain="0.001 to 1")
evaluate_length = EvaluateLength(Curve=curves, Length=curve_overlap, Normalized=False)  # -> Point, Tangent, Parameter
merge_3 = Merge(Data1=filename_extension, Data2=get_time_py.time_string, Data3=file_extension)
construct_domain = ConstructDomain(DomainStart=0, DomainEnd=evaluate_length.Parameter)
text_join_2 = TextJoin(Text=merge_3)

# ---- group: Homing Options
homingsequence_txt = Text(text_join)

# ----
sub_curve_2 = SubCurve(BaseCurve=curves, Domain=construct_domain)
merge_4 = Merge(Data1=graft(sub_curve_2), Data2=graft(sub_curve))
end_points = EndPoints(Curve=sub_curve_2)  # -> Start, End
join_curves = JoinCurves(Curves=merge_4, Preserve=False)
curve = Curve(<curve referenced from the Rhino model>)
point_list = PointList(Points=end_points.Start, Size=Slider(20, range=0..100))
number_slider = Slider(0, range=0..1000)
flip_curve = FlipCurve(Curve=curve)  # -> Curve, Flag
length = Length(Curve=join_curves)
vector_xyz = VectorXYZ(XComponent=number_slider, YComponent=number_slider, ZComponent=0)  # -> Vector, Length
sort_list = SortList(Keys=length, ValuesValuesA=join_curves)  # -> Keys, ValuesValuesA
move = Move(Geometry=flip_curve.Curve, Motion=vector_xyz.Vector)  # -> Geometry, Transform
unit_z = UnitZ(Factor=first_layer_height)
list_item = ListItem(List=sort_list.ValuesValuesA, Index="-1", Wrap=True)
unit_z_2 = UnitZ(Factor=first_layer_height)
closed = Closed(Curve=flatten(curves))  # -> Closed, Periodic
number = Number(segment_length)
move_2 = Move(Geometry=move.Geometry, Motion=unit_z)  # -> Geometry, Transform
pick_n_choose = PickNChoose(Pattern=closed.Closed, Stream0=curves, Stream1=flatten(list_item))
curve_2 = Curve(reparameterize(move_2.Geometry))
move_3 = Move(Geometry=pick_n_choose, Motion=unit_z_2)  # -> Geometry, Transform
bounding_box = BoundingBox(Content=curve_2, Plane=PlaneXY(0, 0, 0))  # -> Box, Box_2
divide_length = DivideLength(Curve=curve_2, Length=number)  # -> Points, Tangents, Parameters
divide_length_2 = DivideLength(Curve=reparameterize(move_3.Geometry), Length=number)  # -> Points, Tangents, Parameters
volume = Volume(Geometry=bounding_box.Box)  # -> Volume, Centroid
point = Point(divide_length.Points)
point_2 = Point(divide_length.Points)
extrusion_multiplication_factor_2 = Number(extrusion_multiplication_factor)
point_3 = Point(simplify(divide_length_2.Points))
data_dam = DataDam(DataDataA=point, BufferDelay=10000000, BufferMode=0)
polyline = PolyLine(Vertices=point_3, Closed="true")  # -> reparameterize(Polyline)
point_4 = Point(data_dam)
control_pts = ControlPoints(Curve=polyline)  # -> Points, Weights, Knots
curve_closest_point = CurveClosestPoint(Point=control_pts.Points, Curve=polyline)  # -> Point, Parameter, Distance
points = Point(divide_length_2.Points)
shatter = Shatter(Curve=polyline, Parameters=simplify(curve_closest_point.Parameter))
deconstruct = Deconstruct(Point=points)  # -> XComponent, YComponent, ZComponent
merge_5 = Merge(Data1=graft(deconstruct.XComponent), Data2=graft(deconstruct.YComponent), Data3=graft(deconstruct.ZComponent))
length_2 = Length(Curve=shatter)  # -> simplify(Length)
format = Format(Format="{0:0.000}", Culture=127, Data0=merge_5)
panel_2 = Panel("""X
Y
Z""")
text_tag = TextTag(Location=curve_closest_point.Point, Text=length_2)
number_2 = Number(length_2)
concatenate = Concatenate(FragmentA=panel_2, FragmentB=format)
boolean = Boolean(extrusion)
number_slider_2 = Slider(7, range=0..10)
insert_items = InsertItems(List=number_2, Item="0", Indices="0", Wrap=True)
tree_statistics = TreeStatistics(Tree=concatenate)  # -> Paths, Length, Count
stream_filter = StreamFilter(Gate=boolean, Stream0="G0", Stream1="G1")
cull_index = CullIndex(List=insert_items, Indices="-1", Wrap=True)
repeat_data = RepeatData(Data=stream_filter, Length=tree_statistics.Count)
list_length = ListLength(List=concatenate)
mass_addition = MassAddition(Input=cull_index)  # -> Result, PartialResults
unflatten_tree = UnflattenTree(Tree=repeat_data, Guide=list_length)
length_of_all_line_segments_to_be_extrud = Number(mass_addition.PartialResults)  # "Length of all line segments to be extruded"
multiplication = Multiplication(A=length_of_all_line_segments_to_be_extrud, B=extrusion_multiplication_factor_2)
merge_6 = Merge(Data1=simplify(unflatten_tree), Data2=simplify(concatenate))
text_join_3 = TextJoin(Text=merge_6, Join=" ")  # -> simplify(Result)
format_2 = Format(Format="{0:0.000}", Culture=127, Data0=multiplication)
# Comment: Finds out how far each of the point is from the next
# 
# adds the appropriate amount of extrusion to each move
panel_3 = Panel("E")
trim_tree = TrimTree(Tree=text_join_3, Depth=1)
concatenate_2 = Concatenate(FragmentA=panel_3, FragmentB=format_2)
text = Text(trim_tree)
text_2 = Text(concatenate_2)
xyz_coordinates = Text(simplify(text))
extrusion_length = Text(text_2)
merge_7 = Merge(Data1=simplify(graft(xyz_coordinates)), Data2=simplify(graft(extrusion_length)))
panel_4 = Panel("G92 E0")
text_join_4 = TextJoin(Text=merge_7, Join=" ")
panel_5 = Panel("""G92 E0
G4 S3
G0 Z10""")
panel_6 = Panel("""0
1
-1""")
trim_tree_2 = TrimTree(Tree=text_join_4, Depth=1)
insert_items_2 = InsertItems(List=trim_tree_2, Item=panel_5, Indices=panel_6, Wrap=True)
xyze_coordinates = Text(flatten(insert_items_2))
starting_gcode = Panel("""M17 ; enable all motors
G4 S2 ; wait for a few seconds
G91 ; use relative coordinates
G0 Z20 ; Move up 20 mm

G92 E0   ;reset Extruder position
M211 S0  ;disable soft endstops
G90  ;use absolute coordinates""")
gcode_before_print = Panel("""G0 Z10
M260 R1
M260 A9
M260 B12; fan-header
M260 B0
M260 S1
M260 R1""")
last_movement = Panel("""G91 
;G0 Z5
G90
M260 R1
M260 A9
M260 B12; fan-header
M260 B20
M260 S1
M260 R1""")

# ---- group: Temperature
boolean_2 = Boolean(wait_for_temperature)
integer = Integer(temperature)

comment = Panel("    ;set temperature ")
stream_filter_2 = StreamFilter(Gate=boolean_2, Stream0="M104 S", Stream1="M105 S")
merge_8 = Merge(Data1=stream_filter_2, Data2=integer, Data3=comment)
text_join_5 = TextJoin(Text=merge_8)

temperaturesetting_txt = Text(text_join_5)

# ---- group: Feedrate
extrusion_bool = Boolean(extrusion)
feedrate_int = Integer(feedrate)

comment_2 = Panel("  ;set feedrate")
stream_filter_3 = StreamFilter(Gate=extrusion_bool, Stream0="G0  F", Stream1="G1  F")
merge_9 = Merge(Data1=stream_filter_3, Data2=feedrate_int, Data3=comment_2)
text_join_6 = TextJoin(Text=merge_9)

setfeedrate_txt = Text(text_join_6)

# ---- group: add extrusion distance
# Comment: Finds out how far each of the point is from the next
# 
# adds the appropriate amount of extrusion to each move
point_5 = Point(simplify(point_2))
extrusion_multiplication_factor_3 = Number(extrusion_multiplication_factor)
panel_7 = Panel("true")

# ---- group: add extrusion distance / Get length of line segments
polyline_2 = PolyLine(Vertices=point_5, Closed=panel_7)  # -> reparameterize(Polyline)
control_pts_2 = ControlPoints(Curve=polyline_2)  # -> Points, Weights, Knots
curve_closest_point_2 = CurveClosestPoint(Point=control_pts_2.Points, Curve=polyline_2)  # -> Point, Parameter, Distance
shatter_2 = Shatter(Curve=polyline_2, Parameters=simplify(curve_closest_point_2.Parameter))
length_3 = Length(Curve=shatter_2)  # -> simplify(Length)

# ----
polyline_3 = PolyLine(Vertices=flatten(point_5), Closed=False)  # -> reparameterize(Polyline)
length_4 = Length(Curve=polyline_3)
end_points_2 = EndPoints(Curve=polyline_3)  # -> Start, End
division = Division(A=length_4, B=500)
point_6 = Point(end_points_2.Start)
text_tag_2 = TextTag(Location=curve_closest_point_2.Point, Text=length_3)

# ---- group: add extrusion distance / Add 0 length extrusion for first coordinate of each circle
tree_statistics_2 = TreeStatistics(Tree=length_3)  # -> Paths, Length, Count
repeat_data_2 = RepeatData(Data="0", Length=tree_statistics_2.Count)  # -> graft(Data)

# ---- group: Create Coordinates from points
point_7 = Point(point_2)
boolean_3 = Boolean(extrusion)

# ---- group: Create Coordinates from points / Coordinates from points
deconstruct_2 = Deconstruct(Point=point_7)  # -> XComponent, YComponent, ZComponent
merge_10 = Merge(Data1=graft(deconstruct_2.XComponent), Data2=graft(deconstruct_2.YComponent), Data3=graft(deconstruct_2.ZComponent))
panel_8 = Panel("2")
panel_9 = Panel("""X
Y
Z""")

# ----
format_3 = Format(Format="{0:0.000}", Culture=127, Data0=merge_10)

# ---- group: Create Coordinates from points / Coordinates from points (continued)
concatenate_3 = Concatenate(FragmentA=panel_9, FragmentB=format_3)

# ---- group: Create Coordinates from points / Choose motion type
stream_filter_4 = StreamFilter(Gate=boolean_3, Stream0="G0", Stream1="G1")
tree_statistics_3 = TreeStatistics(Tree=concatenate_3)  # -> Paths, Length, Count
repeat_data_3 = RepeatData(Data=stream_filter_4, Length=tree_statistics_3.Count)

# ---- group: Create Coordinates from points
list_length_2 = ListLength(List=concatenate_3)
unflatten_tree_2 = UnflattenTree(Tree=repeat_data_3, Guide=list_length_2)

# ---- group: Create Coordinates from points / Merge and join
merge_11 = Merge(Data1=simplify(unflatten_tree_2), Data2=simplify(concatenate_3))
text_join_7 = TextJoin(Text=merge_11, Join=" ")  # -> simplify(Result)

# ---- group: Create Coordinates from points (continued)
text_3 = Text(text_join_7)

# ---- group: add extrusion distance
merge_12 = Merge(Data1=simplify(graft(repeat_data_2)), Data2=length_3)
number_3 = Number(graft(length_3))

# ----
number_4 = Number(flatten(number_3))
insert_items_3 = InsertItems(List=flatten(number_3), Item="0", Indices="0", Wrap=True)
cull_index_2 = CullIndex(List=insert_items_3, Indices="-1", Wrap=True)

# ---- group: add extrusion distance / Multiply with extrusion factor
mass_addition_2 = MassAddition(Input=flatten(cull_index_2))  # -> Result, PartialResults
multiplication_2 = Multiplication(A=mass_addition_2.PartialResults, B=extrusion_multiplication_factor_3)
length_of_all_line_segments_to_be_extrud_2 = Number(mass_addition_2.PartialResults)  # "Length of all line segments to be extruded"

# ----
format_4 = Format(Format="{0:0.000}", Culture=127, Data0=multiplication_2)

# ---- group: add extrusion distance (continued)
concatenate_4 = Concatenate(FragmentA="E", FragmentB=format_4)

text_4 = Text(concatenate_4)

# ---- group: Merge XYZ and E values
xyz_coordinates_2 = Text(simplify(flatten(text_3)))
extrusion_length_2 = Text(text_4)

merge_13 = Merge(Data1=simplify(graft(xyz_coordinates_2)), Data2=simplify(graft(extrusion_length_2)))
text_join_8 = TextJoin(Text=merge_13, Join=" ")
flatten_tree = FlattenTree(Tree=text_join_8, Path="{0}")

text_5 = Text(flatten_tree)

# ---- group: Merge gcode
xyze_coordinates_2 = Text(flatten(xyze_coordinates))
final_movement = Text(last_movement)
starting_gcode_2 = Text(starting_gcode)
feedrate_2 = Text(setfeedrate_txt)
homing = Text(homingsequence_txt)
temperature_2 = Text(temperaturesetting_txt)

merge_14 = Merge(
    Data1=starting_gcode_2,
    Data2=homing,
    Data3=temperature_2,
    Data4=feedrate_2,
    Data5=gcode_before_print,
    Data6=xyze_coordinates_2,
    Data7=final_movement)
text_join_9 = TextJoin(Text=merge_14)

finalgcode_txt = Text(text_join_9)

# ----
final_gcode = Panel(finalgcode_txt)  # disabled

file_name_extension = Text(text_join_2)
save_trigger = Boolean(save_file)
file_path_3 = FilePath(file_path_2)
gcode = Text(finalgcode_txt)
ghpython_script = GhPythonScript(Save=save_trigger, Filepath=file_path_3, Filename=file_name_extension, Content=gcode)  # -> out, a; inputs Save: Boolean
# ---------- ghpython_script: Python ----------
__author__ = "robin godwyll"

import rhinoscriptsyntax as rs
import os 
fullpath = Filepath + "/" + Filename  #combine filepath and filename to get the target path

if Save:
    file_obj = open(fullpath,"w+")  #open the target path file, create it if it doesnt exist
    file_obj.write(Content)
    file_obj.close()
    a= "success"
# ---------- end ghpython_script ----------
success = Panel(ghpython_script.a)

panel_10 = Panel(finalgcode_txt)
